# Grasshopper definition 20250106_script study_1.gh (Grasshopper 1.0.8)
# plug-ins: RhinoCodePluginGH

# DATE- 2024.11.11 TI11E- 10:3210
# Last saved by - Administrator
# Total Components - 31
# Maths.Script.C# Script - 9
# Maths.Script.Python 3 Script - 3
# Maths.Script.CSharp Script - 1
# Maths.Script.Plugin Find - 1
# Maths.Script.Script - 1
# Maths.Script.extend sueface - 1
# Maths.Script. 获得正切边缘 - 1
# Maths.Script.Explode mesh At angle - 1
# Maths.Script.extrudemesh - 1
# Maths.Script.Explode mesh At UnweldedEdges - 1
# Maths.Script.set_camera  & get_meshoutline - 1
# Maths.Operators.Addition - 1
# Maths.Domain.Construct Domain - 1
# Sets.Sequence.Random - 1
# Sets.List.List Item - 2
# Sets.Tree.Explode Tree - 2
# Surface.Analysis.Deconstruct Brep - 2
# Vector.Vector.Unit Z - 1
# DATE- 2024.11.12 TI11E- 13:341
# Last saved by - Administrator
# Total Components - 27
# Maths.Script.C# Script - 9
# Maths.Script.Python 3 Script - 3
# Maths.Script.CSharp Script - 1
# Maths.Script.Plugin Find - 1
# Maths.Script.Script - 1
# Maths.Script.extend sueface - 1
# Maths.Script. 获得正切边缘 - 1
# Maths.Script.Explode mesh At angle - 1
# Maths.Script.extrudemesh - 1
# Maths.Script.Explode mesh At UnweldedEdges - 1
# Maths.Script.set_camera  & get_meshoutline - 1
# Maths.Operators.Addition - 1
# Maths.Domain.Construct Domain - 1
# Sets.Sequence.Random - 1
# Sets.Tree.Explode Tree - 2
# Vector.Vector.Unit Z - 1
plugins_used = Panel("RhinoCodePluginGH ")
plugins_used_2 = Panel("RhinoCodePluginGH ")

# ----
# C# 调用电池功能
number_slider = Slider(10, range=0..10)
调用电池功能 = CSharpScript(x="Addition", y=number_slider, z=Slider(5, range=0..10))  # -> out, a, b, c; inputs x: String, y: Int32, z: Int32
# ---------- 调用电池功能: C# ----------
// Grasshopper Script Instance
#region Usings
using System;
using System.Linq;
using System.Collections;
using System.Collections.Generic;
using System.Drawing;

using Rhino;
using Rhino.Geometry;

using Grasshopper;
using Grasshopper.Kernel;
using Grasshopper.Kernel.Data;
using Grasshopper.Kernel.Types;
#endregion

public class Script_Instance : GH_ScriptInstance
{
    private void RunScript(
	string x,
	int y,
	int z,
	ref object a,
	ref object b,
	ref object c)
    {
        var qwe = Rhino.NodeInCode.Components.FindComponent(x);

        var qwe_function = (System.Func<object, object, object>) qwe.Delegate;

        a = qwe_function(y,z);
        b = qwe;
        c = qwe_function;
    }
}
# ---------- end 调用电池功能 ----------
panel = Panel(调用电池功能.b)
panel_2 = Panel(调用电池功能.c)
panel_3 = Panel(调用电池功能.a)

# ----
# C# 查找可调用功能的电池
查找可调用电池 = CSharpScript()  # -> out, a
# ---------- 查找可调用电池: C# ----------
// Grasshopper Script Instance
#region Usings
using System;
using System.Linq;
using System.Collections;
using System.Collections.Generic;
using System.Drawing;

using Rhino;
using Rhino.Geometry;

using Grasshopper;
using Grasshopper.Kernel;
using Grasshopper.Kernel.Data;
using Grasshopper.Kernel.Types;
#endregion

public class Script_Instance : GH_ScriptInstance
{
    private void RunScript(ref object a)
    {
        var qwe = Rhino.NodeInCode.Components.NodeInCodeFunctions.GetDynamicMemberNames();
        a = qwe;
    }
}
# ---------- end 查找可调用电池 ----------
panel_4 = Panel(查找可调用电池.a)

# ----
# 查找已运行电池与各类型数量
button = Button()
plugin_find = PluginFind(x=button)  # -> out, a; inputs x: Boolean
# ---------- plugin_find: C# ----------
#region Usings
using System;
using System.Collections.Generic;
using System.Drawing;

using Grasshopper;
using Grasshopper.Kernel;
using Grasshopper.Kernel.Special;
#endregion

public class Script_Instance : GH_ScriptInstance
{  
    private string formatted;

    private void CheckCanvas()
    {
        bool note = false;
        var ghdoc = Instances.ActiveCanvas.Document;

        foreach (var obj in ghdoc.Objects)
        {
            if (obj is GH_Panel panel && panel.NickName == "All Components Used")
            {
                panel.UserText = AnalyzeActiveGhDoc();
                panel.ExpireSolution(true);
                note = true;
                break;
            }
        }

        if (!note)
        {
            MakeCompsPanel();
        }
    }

    private void CheckCanvas2()
    {
        bool note2 = false;
        var ghdoc = Instances.ActiveCanvas.Document;

        foreach (var obj in ghdoc.Objects)
        {
            if (obj is GH_Panel panel && panel.NickName == "PlugIns Used")
            {
                panel.UserText = formatted;
                panel.ExpireSolution(true);
                note2 = true;
                break;
            }
        }

        if (!note2)
        {
            MakePlugInsPanel();
        }
    }

    private void MakeCompsPanel()
    {
        var panel = new GH_Panel();
        panel.Name = "All Components Used";
        panel.UserText = AnalyzeActiveGhDoc();
        panel.Properties.Colour = Color.LightPink;
        panel.Properties.Font = new Font("Trebuchet MS", 10);
        panel.Properties.Multiline = false;
        panel.CreateAttributes();
        Instances.ActiveCanvas.Document.AddObject(panel, false, Instances.ActiveCanvas.Document.ObjectCount+1);
        panel.Attributes.Pivot = new PointF(-345, 0);
        panel.Attributes.Bounds = new RectangleF(-330, 0, 330, 450);
        
    }

    private void MakePlugInsPanel()
    {
        var panel = new GH_Panel();
        panel.Name = "PlugIns Used";
        panel.UserText = formatted;
        panel.Properties.Colour = Color.HotPink;
        panel.Properties.Font = new Font("Trebuchet MS", 10);
        panel.Properties.Multiline = false;
        panel.CreateAttributes();
        Instances.ActiveCanvas.Document.AddObject(panel, false,Instances.ActiveCanvas.Document.ObjectCount+1);
        panel.Attributes.Pivot = new PointF(-690, 0);
        panel.Attributes.Bounds = new RectangleF(-330, 0, 330, 150);
        
    }

   /* private Tuple<Dictionary<Guid, GH_AssemblyInfo>, Dictionary<Guid, GH_AssemblyInfo>> Libraries()
    {
        var coreLibraries = new Dictionary<Guid, GH_AssemblyInfo>();
        var addonLibraries = new Dictionary<Guid, GH_AssemblyInfo>();
        var server = Instances.ComponentServer;

        foreach (var obj in Instances.ActiveCanvas.Document.Objects)
        {
            if (obj is IGH_Component)
            {
                var component = obj as IGH_Component;
                var objId = obj.ComponentGuid;

                if (objId != Guid.Empty && !coreLibraries.ContainsKey(objId) && !addonLibraries.ContainsKey(objId))
                {
                    var lib = server.FindAssemblyByObject(obj);
                    if (lib != null)
                    {
                        if (lib.IsCoreLibrary)
                            coreLibraries.Add(lib.Id, lib);
                        else
                            addonLibraries.Add(lib.Id, lib);
                    }
                }
            }
        }

        return Tuple.Create(coreLibraries, addonLibraries);
    }*/
     public (Dictionary<Guid, GH_AssemblyInfo>, Dictionary<Guid, GH_AssemblyInfo>) Libraries()
    {
        Dictionary<Guid, GH_AssemblyInfo> coreLibraries = new Dictionary<Guid, GH_AssemblyInfo>();
        Dictionary<Guid, GH_AssemblyInfo> addonLibraries = new Dictionary<Guid, GH_AssemblyInfo>();
        Dictionary<Guid, string> objids = new Dictionary<Guid, string>();

        var server = Grasshopper.Instances.ComponentServer;
        foreach (var obj in GrasshopperDocument.Objects)
        {
            var objId = obj.ComponentGuid;
            if (objids.ContainsKey(objId)) continue;
            objids[objId] = "";

            var lib = server.FindAssemblyByObject(obj);
            if (lib == null) continue;
            if (coreLibraries.ContainsKey(lib.Id) || addonLibraries.ContainsKey(lib.Id)) continue;

            if (lib.IsCoreLibrary)
            {
                coreLibraries[lib.Id] = lib;
            }
            else
            {
                addonLibraries[lib.Id] = lib;
            }
        }
        return (coreLibraries, addonLibraries);
    }

    private string AnalyzeActiveGhDoc()
    {
        int compCount = 0;
        var dictComponents = new Dictionary<string, Dictionary<string, Dictionary<string, int>>>();

        foreach (var obj in Instances.ActiveCanvas.Document.Objects)
        {
            if (obj is IGH_Component)
            {
                var component = obj as IGH_Component;
                var category = component.Category;
                var subCategory = component.SubCategory;
                var name = component.Name;

                if (!dictComponents.ContainsKey(category))
                    dictComponents[category] = new Dictionary<string, Dictionary<string, int>>();

                if (!dictComponents[category].ContainsKey(subCategory))
                    dictComponents[category][subCategory] = new Dictionary<string, int>();

                if (!dictComponents[category][subCategory].ContainsKey(name))
                    dictComponents[category][subCategory][name] = 0;

                dictComponents[category][subCategory][name]++;
                compCount++;
            }
        }

        string username = Environment.UserName;
        string panelText = $"{DateTime.Now.ToString("DATE- yyyy.MM.dd TIME- HH:mmh")}\n";
        panelText += $"Last saved by - {username}\n";
        panelText += $"Total Components - {compCount}\n";

        foreach (var category in dictComponents)
        {
            foreach (var subCategory in category.Value)
            {
                foreach (var comp in subCategory.Value)
                {
                    panelText += $"{category.Key}.{subCategory.Key}.{comp.Key} - {comp.Value}\n";
                }
            }
        }

        return panelText;
    }
    private void RunScript(bool x, ref object a)
    {
        if (x)
        {
            var coreLibraries = Libraries().Item1;
            var addonLibraries = Libraries().Item2;

            List<string> adds = new List<string>();
            foreach (var lib in addonLibraries.Values)
            {
                if (!string.IsNullOrEmpty(lib.Name))
                    adds.Add($"{lib.Name} {lib.Version}");
            }

            formatted = string.Join("\n", adds);

            CheckCanvas();
            CheckCanvas2();
        }
    }
}
# ---------- end plugin_find ----------
plugin_find_2 = CSharpScript(x=Button())  # -> out, a; inputs x: Boolean
# ---------- plugin_find_2: C# ----------
// Grasshopper Script Instance
#region Usings
using System;
using System.Collections;
using System.Collections.Generic;
using System.Drawing;

using Rhino;
using Rhino.Geometry;

using Grasshopper;
using Grasshopper.Kernel;
using Grasshopper.Kernel.Data;
using Grasshopper.Kernel.Types;
using Grasshopper.Kernel.Special;
#endregion

public class Script_Instance : GH_ScriptInstance
{  
    private string formatted;

    private void CheckCanvas()
    {
        bool note = false;
        var ghdoc = Instances.ActiveCanvas.Document;

        foreach (var obj in ghdoc.Objects)
        {
            if (obj is GH_Panel panel && panel.NickName == "All Components Used")
            {
                panel.UserText = AnalyzeActiveGhDoc();
                panel.ExpireSolution(true);
                note = true;
                break;
            }
        }

        if (!note)
        {
            MakeCompsPanel();
        }
    }

    private void CheckCanvas2()
    {
        bool note2 = false;
        var ghdoc = Instances.ActiveCanvas.Document;

        foreach (var obj in ghdoc.Objects)
        {
            if (obj is GH_Panel panel && panel.NickName == "PlugIns Used")
            {
                panel.UserText = formatted;
                panel.ExpireSolution(true);
                note2 = true;
                break;
            }
        }

        if (!note2)
        {
            MakePlugInsPanel();
        }
    }

    private void MakeCompsPanel()
    {
        var panel = new GH_Panel();
        panel.Name = "All Components Used";
        panel.UserText = AnalyzeActiveGhDoc();
        panel.Properties.Colour = Color.LightSkyBlue;
        panel.Properties.Font = new Font("Trebuchet MS", 10);
        panel.Properties.Multiline = false;
        panel.CreateAttributes();
        panel.Attributes.Pivot = new PointF(-345, 0);
        panel.Attributes.Bounds = new RectangleF(-330, 0, 330, 450);
        Instances.ActiveCanvas.Document.AddObject(panel, false);
    }

    private void MakePlugInsPanel()
    {
        var panel = new GH_Panel();
        panel.Name = "PlugIns Used";
        panel.UserText = formatted;
        panel.Properties.Colour = Color.LightSkyBlue;
        panel.Properties.Font = new Font("Trebuchet MS", 10);
        panel.Properties.Multiline = false;
        panel.CreateAttributes();
        panel.Attributes.Pivot = new PointF(-690, 0);
        panel.Attributes.Bounds = new RectangleF(-330, 0, 330, 150);
        Instances.ActiveCanvas.Document.AddObject(panel, false);
    }

    private Tuple<Dictionary<Guid, GH_AssemblyInfo>, Dictionary<Guid, GH_AssemblyInfo>> Libraries()
    {
        var coreLibraries = new Dictionary<Guid, GH_AssemblyInfo>();
        var addonLibraries = new Dictionary<Guid, GH_AssemblyInfo>();
        var server = Instances.ComponentServer;

        foreach (var obj in Instances.ActiveCanvas.Document.Objects)
        {
            var objId = obj.ComponentGuid;
            if (obj is IGH_Component)
            {
                if (objId != Guid.Empty && !coreLibraries.ContainsKey(objId) && !addonLibraries.ContainsKey(objId))
                {
                    var lib = server.FindAssemblyByObject(obj);
                    if (lib != null)
                    {
                        if (lib.IsCoreLibrary)
                            coreLibraries.Add(lib.Id, lib);
                        /*else
                            addonLibraries.Add(lib.Id, lib);*/
                    }
                }
            }
        }

        return Tuple.Create(coreLibraries, addonLibraries);
    }

    private string AnalyzeActiveGhDoc()
    {
        int compCount = 0;
        var dictComponents = new Dictionary<string, Dictionary<string, Dictionary<string, int>>>();

        foreach (var obj in Instances.ActiveCanvas.Document.Objects)
        {
            if (obj is IGH_Component)
            {
                var component = obj as IGH_Component;
                var category = component.Category;
                var subCategory = component.SubCategory;
                var name = component.Name;

                if (!dictComponents.ContainsKey(category))
                    dictComponents[category] = new Dictionary<string, Dictionary<string, int>>();

                if (!dictComponents[category].ContainsKey(subCategory))
                    dictComponents[category][subCategory] = new Dictionary<string, int>();

                if (!dictComponents[category][subCategory].ContainsKey(name))
                    dictComponents[category][subCategory][name] = 0;

                dictComponents[category][subCategory][name]++;
                compCount++;
            }
        }

        string username = Environment.UserName;
        string panelText = $"{DateTime.Now.ToString("DATE- yyyy.MM.dd TIME- HH:mmh")}\n";
        panelText += $"Last saved by - {username}\n";
        panelText += $"Total Components - {compCount}\n";

        foreach (var category in dictComponents)
        {
            foreach (var subCategory in category.Value)
            {
                foreach (var comp in subCategory.Value)
                {
                    panelText += $"{category.Key}.{subCategory.Key}.{comp.Key} - {comp.Value}\n";
                }
            }
        }

        return panelText;
    }
    private void RunScript(bool x, ref object a)
    {
        if (x)
        {
            var coreLibraries = Libraries().Item1;
            var addonLibraries = Libraries().Item2;

            List<string> adds = new List<string>();
            foreach (var lib in addonLibraries.Values)
            {
                if (!string.IsNullOrEmpty(lib.Name))
                    adds.Add($"{lib.Name} {lib.Version}");
            }

            formatted = string.Join("\n", adds);

            CheckCanvas();
            CheckCanvas2();
        }
    }
      
    
}
# ---------- end plugin_find_2 ----------

# ----
# python 查找已用电池并传输参数
number_slider_2 = Slider(41, range=0..100)
genes = GenePool(
    Decimals=8,
    Maximum=52,
    Minimum=25,
    Value=[40.64728719, 49.92045611, 34.13095103, 40.33899888, 40.80963743, 37.06845392, 25],
    _0="62.832042375966921099461615085601806640625",
    _1="35.312194607831628445637761615216732025146484375",
    _2="17.44990027623712336435346514917910099029541015625",
    _3="78.87852894555709326596115715801715850830078125",
    _4="13.1753475163948490234133714693598449230194091796875",
    _5="28.001030598767581381025593145750463008880615234375",
    _6="65.16053458916047702587093226611614227294921875",
    _7="38.41600092054158466225999291054904460906982421875",
    _8="21.87373654771304387622876674868166446685791015625",
    _9="5.84049897307553322889361879788339138031005859375")
滑杆控制基因池数量 = Python3Script(count=number_slider_2)  # -> a
# ---------- 滑杆控制基因池数量: Python ----------
ghDoc = ghenv.Component.OnPingDocument()
objs = ghDoc.Objects
for obj in objs:
    if obj.NickName == 'G1':
        obj.Count=count
        obj.ExpireSolution(True)
        obj.Randomize(True)
        a = obj
# ---------- end 滑杆控制基因池数量 ----------
d = Slider(8, range=0..10)
panel_5 = Panel(滑杆控制基因池数量)
count = Slider(7, range=0..30)
max = Slider(25, range=0..100)
min = Slider(52, range=0..100)
dom = ConstructDomain(DomainStart=min, DomainEnd=max)
random = Random(Range=dom, Number=count, Seed=2)
g1 = GenePool(
    Decimals=2,
    Maximum=1,
    Minimum=0,
    Value=[0.7983734655, 0.1908690852, 0.3620656929, 0.3065286447, 0.2346499828, 0.8642234726, 0.1027450185, 0.7442745293, 0.6638142126, 0.160784912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])
py3 = Python3Script(genePool=genes, values=random, decimals=d, interval=dom)  # inputs genePool: list, values: list, decimals: Int32
# ---------- py3: Python ----------
from System import Convert

if genePool and values:
    if values[0]:
        gp = ghenv.Component.Params.Input[0].Sources[0]
        if (
            gp.Decimals != decimals
            or Convert.ToSingle(gp.Maximum) != interval.Max
            or Convert.ToSingle(gp.Minimum) != interval.Min
            or gp.Count != len(values)
        ):
            gp.Decimals = decimals
            gp.Maximum = Convert.ToDecimal(interval.Max)
            gp.Minimum = Convert.ToDecimal(interval.Min)
            gp.Count = len(values)
            for i in range(gp.Count):
                gp.__setitem__(i, Convert.ToDecimal(values[i]))
            gp.ExpireSolution(True)
            gp.Randomize(True)
# ---------- end py3 ----------

# ----
# C# nickname查找并更改Genepool结果
# （使用foreach遍历，改变数据后运行一次）
number_slider_3 = Slider(95.487, range=0..100)
g2 = GenePool(Decimals=4, Maximum=95.487, Minimum=8.857, Value=[11, 11, 20.04034714, 69.50058566, 92.72093919])
panel_6 = Panel("""11
11""")
script = Script(
    nickname="G2",
    values=panel_6,
    count=Slider(5, range=0..30),
    decimals=Slider(4, range=0..10),
    min=Slider(8.857, range=0..100),
    max=number_slider_3)  # inputs nickname: String, values: list, count: Int32, decimals: Int32, min: Double, max: Double
# ---------- script: C# ----------
// Grasshopper Script Instance
#region Usings
using System;
using System.Linq;
using System.Collections;
using System.Collections.Generic;
using System.Drawing;

using Rhino;
using Rhino.Geometry;

using Grasshopper;
using Grasshopper.Kernel;
using Grasshopper.Kernel.Data;
using Grasshopper.Kernel.Types;
#endregion

public class Script_Instance : GH_ScriptInstance
{
    private void RunScript(
	string nickname,
	List<object> values,
	int count,
	int decimals,
	double min,
	double max)
    {
     var doc = this.Component.OnPingDocument();
        var objs = doc.Objects;
        foreach (var docObj in objs) 
        {
         var objNickname = docObj.NickName;
         if (objNickname == nickname)
         {
             var method_decimals = docObj.GetType().GetMethod("set_Decimals");
             method_decimals.Invoke(docObj, new object[]{decimals});

             var method_count = docObj.GetType().GetMethod("set_Count");
             method_count.Invoke(docObj, new object[]{count});

             var method_maximum = docObj.GetType().GetMethod("set_Maximum");
             method_maximum.Invoke(docObj, new object[]{Convert.ToDecimal(max)});

             var method_minimum = docObj.GetType().GetMethod("set_Minimum");
             method_minimum.Invoke(docObj, new object[]{Convert.ToDecimal(min)});

             var method_randomize = docObj.GetType().GetMethod("Randomize");
             method_randomize.Invoke(docObj, new object[]{1});

             var method_values = docObj.GetType().GetMethod("set_Value");
             for(var i = 0;i < values.Count;i++)
             {
             method_values.Invoke(docObj, new object[]{i, Convert.ToDecimal(values[i])});
             }
             
             docObj.ExpireSolution(true);
             
         }
        }
    }
}
# ---------- end script ----------

# ----
# C# 连接后查找GUID并更改Genepool结果
# （查找Method  和 Property，
# 得到Property的值，修改method参数）
# 暂未解决持续运行问题
# （使用foreach遍历？使用if决定是否运行？）
number_slider_4 = Slider(6, range=0..30)
genes1 = GenePool(Decimals=5, Maximum=25.686, Minimum=1.228, Value=[11, 22, 12.936, 12.936, 12.936, 12.936])
panel_7 = Panel("""11
22""")
script_2 = Script(
    genepool=genes1,
    values=panel_7,
    count=number_slider_4,
    decimals=Slider(5, range=0..10),
    min=Slider(1.228, range=0..100),
    max=Slider(25.686, range=0..100))  # -> a, b, c; inputs genepool: list, values: list of Double, count: Int32, decimals: Int32, min: Double, max: Double
# ---------- script_2: C# ----------
// Grasshopper Script Instance
#region Usings
using System;
using System.Linq;
using System.Collections;
using System.Collections.Generic;
using System.Drawing;

using Rhino;
using Rhino.Geometry;

using Grasshopper;
using Grasshopper.Kernel;
using Grasshopper.Kernel.Data;
using Grasshopper.Kernel.Types;
#endregion

public class Script_Instance : GH_ScriptInstance
{
    private void RunScript(
	List<object> genepool,
	List<double> values,
	int count,
	int decimals,
	double min,
	double max,
	ref object a,
	ref object b,
	ref object c)
    {
     Guid[] genepool_id = Component.Params.Input[0].Sources.Select(param => param.Attributes.GetTopLevel.DocObject.InstanceGuid).ToArray();;
     Guid genepool_id1 = genepool_id[0];
     
     var docObj = GrasshopperDocument.FindObject(genepool_id1, true);

     a = docObj.GetType().GetMethods();
     b = docObj.GetType().GetProperties();
     c = docObj.GetType().GetProperty("Count").GetValue(docObj,null);

     var method_decimals = docObj.GetType().GetMethod("set_Decimals");
     method_decimals.Invoke(docObj, new object[]{decimals});

     var method_count = docObj.GetType().GetMethod("set_Count");
     method_count.Invoke(docObj, new object[]{count});

     var method_maximum = docObj.GetType().GetMethod("set_Maximum");
     method_maximum.Invoke(docObj, new object[]{Convert.ToDecimal(max)});

     var method_minimum = docObj.GetType().GetMethod("set_Minimum");
     method_minimum.Invoke(docObj, new object[]{Convert.ToDecimal(min)});

     var method_values = docObj.GetType().GetMethod("set_Value");
     for(var i = 0;i < values.Count;i++)
     {
         method_values.Invoke(docObj, new object[]{i, Convert.ToDecimal(values[i])});
     }

     docObj.ExpireSolution(true);

     //var method_randomize = docObj.GetType().GetMethod("Randomize");
     //method_randomize.Invoke(docObj, new object[]{1});
    }
}
# ---------- end script_2 ----------
panel_8 = Panel(script_2.b)
panel_9 = Panel(script_2.a)
panel_10 = Panel(script_2.c)

# ----
# C# nickname查找已用电池与输入/传输参数
number_slider_5 = Slider(70, range=0..100)
nickname查找电池 = CSharpScript(nickname="poi", index=Slider(1, range=0..1), x=number_slider_5)  # -> out, a, b, c, d, e; inputs nickname: String, index: Int32, x: Double
# ---------- nickname查找电池: C# ----------
#region Usings
using System;
using System.Linq;
using System.Collections;
using System.Collections.Generic;
using System.Drawing;

using Rhino;
using Rhino.Geometry;

using Grasshopper;
using Grasshopper.Kernel;
using Grasshopper.Kernel.Data;
using Grasshopper.Kernel.Types;
using System.Linq;
#endregion

public class Script_Instance : GH_ScriptInstance
{
    private void RunScript(
	string nickname,
	int index,
	double x,
	ref object a,
	ref object b,
	ref object c,
	ref object d,
	ref object e)
    {
        var doc = this.Component.OnPingDocument();
        var objs = doc.Objects;
        foreach (var obj in objs) 
        {
            var obj_nickname1 = obj.NickName;
            if (obj_nickname1 == nickname)
            {
                a = obj;
                break;
            } 
        }
         
         var ghdoc = Instances.ActiveCanvas.Document;
         var ghobjs = ghdoc.Objects;
         foreach (var obj in ghobjs) 
        {
            var obj_nickname2 = obj.NickName;
            if (obj_nickname2 == nickname)
            {
                b = obj;
                break;
            } 
        }
         
         GH_Component com_b = (GH_Component)b;
         var ip_1 = com_b.Params.Input[index].VolatileData;
         c = ip_1;

         var method_1 = com_b.Params.Input[index].GetType().GetMethods();
         d = method_1;

         var method_2 = com_b.GetType().GetMethods();
         e = method_2;

         if(x != null)
         {
         com_b.Params.Input[1].VolatileData.Clear();
         com_b.Params.Input[1].AddVolatileData(new GH_Path(0), 0, x);
         }

         com_b.ExpireSolution(true);
    }
}
# ---------- end nickname查找电池 ----------
panel_11 = Panel(nickname查找电池.a)
panel_12 = Panel(nickname查找电池.b)
panel_13 = Panel(nickname查找电池.d)
panel_14 = Panel(nickname查找电池.c)
panel_15 = Panel(nickname查找电池.e)
poi = Addition(A="6", B="8")
panel_16 = Panel(poi)

# ----
# 混接曲面
number_slider_6 = Slider(3, range=0..4)
brep = Brep(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)
brep_2 = Brep(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)
c_script = CSharpScript(
    surface1=brep,
    edge_index1=Slider(7, range=0..100),
    sur_con1=number_slider_6,
    flip_sur1=Toggle(False),
    surface2=brep_2,
    edge_index2=Slider(10, range=0..100),
    sur_con2=Slider(3, range=0..4),
    flip_sur2=Toggle(True))  # -> out, curves, blend_srf; inputs surface1: Brep, edge_index1: Int32, sur_con1: Int32, flip_sur1: Boolean, surface2: Brep, edge_index2: Int32, sur_con2: Int32, flip_sur2: Boolean
# ---------- c_script: C# ----------
// Grasshopper Script Instance
#region Usings
using System;
using System.Linq;
using System.Collections;
using System.Collections.Generic;
using System.Drawing;

using Rhino;
using Rhino.Geometry;

using Grasshopper;
using Grasshopper.Kernel;
using Grasshopper.Kernel.Data;
using Grasshopper.Kernel.Types;
#endregion

 public class Script_Instance : GH_ScriptInstance
{
    private void RunScript(
	Brep surface1,
	int edge_index1,
	int sur_con1,
	bool flip_sur1,
	Brep surface2,
	int edge_index2,
	int sur_con2,
	bool flip_sur2,
	ref object curves,
	ref object blend_srf)
    {
       BrepEdge brepedge1 = surface1.Edges[edge_index1];
       BrepFace brepface1;
       if(brepedge1.Valence == EdgeAdjacency.Naked)
       {
        int brepface_index1 = brepedge1.AdjacentFaces()[0];
        brepface1 = surface1.Faces[brepface_index1];
       }
       else
       brepface1 = null;

       BrepEdge brepedge2 = surface2.Edges[edge_index2];
       BrepFace brepface2;
       if(brepedge2.Valence == EdgeAdjacency.Naked)
       {
        int brepface_index2 = brepedge2.AdjacentFaces()[0];
        brepface2 = surface2.Faces[brepface_index2];
       }
       else
       brepface2 = null;

       Brep[] blend_srf1 = null;
       
       if (brepface1 != null && brepface2 != null)
       {
        blend_srf1 = Brep.CreateBlendSurface(
        brepface1,
        brepedge1,
        brepedge1.Domain,
        flip_sur1,
        (BlendContinuity) sur_con1,
        brepface2,
        brepedge2,
        brepedge2.Domain,
        flip_sur2,
        (BlendContinuity) sur_con2);
       }

       List<Curve> blendcurves1 = new List<Curve>();
       blendcurves1.Add(brepedge1);
       blendcurves1.Add(brepedge2);
       curves = blendcurves1;
       blend_srf = blend_srf1;
    }
}
# ---------- end c_script ----------
curve = Curve(c_script.curves)
surface = Surface(c_script.blend_srf)

# ----
# C#  延申曲面
number_slider_7 = Slider(9, range=0..100)
surface_2 = Surface(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)
extend_sueface = ExtendSueface(
    surface=surface_2,
    north=Slider(29, range=0..100),
    south=number_slider_7,
    west=Slider(21, range=0..100),
    east=Slider(27, range=0..100))  # -> out, es; inputs surface: Surface, north: Double, south: Double, west: Double, east: Double
# ---------- extend_sueface: C# ----------
// Grasshopper Script Instance
using System;
using System.Collections;
using System.Collections.Generic;
using System.Drawing;

using Rhino;
using Rhino.Geometry;

using Grasshopper;
using Grasshopper.Kernel;
using Grasshopper.Kernel.Data;
using Grasshopper.Kernel.Types;

public class Script_Instance : GH_ScriptInstance
{
  /* 
	Members:
	  RhinoDoc RhinoDocument
	  GH_Document GrasshopperDocument
	  IGH_Component Component
	  int Iteration

	Methods (Virtual & overridable):
	  Print(string text)
	  Print(string format, params object[] args)
	  Reflect(object obj)
	  Reflect(object obj, string method_name)
  */
  
  private void RunScript(
	Surface surface,
	double north,
	double south,
	double west,
	double east,
	ref object es)
  {
	if (north != 0) 
	 surface = surface.Extend(IsoStatus.North, north, true);
	if (south != 0) 
	 surface = surface.Extend(IsoStatus.South, south, true);
	if (west != 0) 
	 surface = surface.Extend(IsoStatus.West, west, true);
	if (east != 0) 
	 surface = surface.Extend(IsoStatus.East, east, true);

	 es = surface;

  }
}
# ---------- end extend_sueface ----------
surface_3 = Surface(extend_sueface.es)

# ----
# C#   控制太阳
number_slider_8 = Slider(5, range=0..12)
value_list = ValueList({"Local": "local", "Utc": "utc"}, selected="Local")
c_script_2 = CSharpScript(
    year=Slider(2006, range=1900..2100),
    month=number_slider_8,
    day=Slider(21, range=1..31),
    hour=Slider(11, range=0..23),
    minute=Slider(59, range=0..59),
    second=Slider(32, range=0..59),
    timetype=value_list,
    latitude=Slider(26, range=-180..180),
    longitude=Slider(43, range=-180..180),
    is_on=Toggle(False))  # inputs year: Int32, month: Int32, day: Int32, hour: Int32, minute: Int32, second: Int32, timetype: String, latitude: Double, longitude: Double, is_on: Boolean
# ---------- c_script_2: C# ----------
// Grasshopper Script Instance
#region Usings
using System;
using System.Linq;
using System.Collections;
using System.Collections.Generic;
using System.Drawing;

using Rhino;
using Rhino.Geometry;
using Rhino.Render;

using Grasshopper;
using Grasshopper.Kernel;
using Grasshopper.Kernel.Data;
using Grasshopper.Kernel.Types;
#endregion

public class Script_Instance : GH_ScriptInstance
{
    private void RunScript(
	int year,
	int month,
	int day,
	int hour,
	int minute,
	int second,
	string timetype,
	double latitude,
	double longitude,
	bool is_on)
    {
        if(is_on)
        {
         DateTime date1 = new DateTime(year, month, day, hour, minute, second);

         DateTimeKind dtk1 = DateTimeKind.Unspecified;
         if(timetype == "local")
         {
             dtk1 = DateTimeKind.Local;
         }
         else if (timetype == "utc")
         {
             dtk1 = DateTimeKind.Utc;
         }
         
         Rhino.Render.Sun sun1 = Rhino.RhinoDoc.ActiveDoc.Lights.Sun;
         sun1.Latitude = latitude;
         sun1.Longitude = longitude;

         sun1.SetDateTime(date1,dtk1);
        }
    }
}
# ---------- end c_script_2 ----------

# ----
# C#   正则表达式
panel_17 = Panel("""0
12
3456
22rhino
studIO33
ba44nana
56Wa78lk910
99卡拉
硂吧23
很98尴68尬
tt
yuitre
爆部炸
n太阳m月亮k
l超人i77vi安下po""")
value_list_2 = ValueList({"提取数据内的数字（全部)": "a1", "提取数据内的数字（开头）": "a2", "提取数据内的数字（中间）": "a3", "提取数据内的数字（结尾）": "a4", "提取只包含数字的数据": "a5", "提取数据内的字母（全部）": "b1", "提取数据内的字母（开头）": "b2", "提取数据内的字母（中间）": "b3", "提取数据内的字母（结尾）": "b4", "提取只包含字母的数据": "b5", "提取数据内的中文（全部）": "c1", "提取数据内的中文（开头）": "c2", "提取数据内的中文（中间）": "c3", "提取数据内的中文（结尾）": "c4", "提取包含只中文的数据": "c5"}, selected="提取数据内的数字（全部)")
正则表达式 = CSharpScript(txt=graft(panel_17), type=value_list_2)  # -> simplify(a); inputs txt: String, type: String
# ---------- 正则表达式: C# ----------
// Grasshopper Script Instance
#region Usings
using System;
using System.Linq;
using System.Collections;
using System.Collections.Generic;
using System.Drawing;
using System.Text.RegularExpressions;

using Rhino;
using Rhino.Geometry;

using Grasshopper;
using Grasshopper.Kernel;
using Grasshopper.Kernel.Data;
using Grasshopper.Kernel.Types;
#endregion

public class Script_Instance : GH_ScriptInstance
{
    private void RunScript(string txt, string type, ref object a)
    {
     string str1 = "";
     
     switch (type)
     {
     case "a1":
     str1 = @"\d+";
     break;

     case "a2":
     str1 = @"^\d+";
     break;

     case "a3":
     str1 = @"\B\d+\B";
     break;

     case "a4":
     str1 = @"\d+$";
     break;

     case "a5":
     str1 = @"^\d+$";
     break;

     case "b1":
     str1 = @"[A-Za-z]+";
     break;

     case "b2":
     str1 = @"^[A-Za-z]+";
     break;

     case "b3":
     str1 = @"\B[A-Za-z]+\B";
     break;

     case "b4":
     str1 = @"[A-Za-z]+$";
     break;

     case "b5":
     str1 = @"^[A-Za-z]+$";
     break;

     case "c1":
     str1 = @"[\u4e00-\u9fa5]+";
     break;

     case "c2":
     str1 = @"^[\u4e00-\u9fa5]+";
     break;

     case "c3":
     str1 = @"\B[\u4e00-\u9fa5]+\B";
     break;

     case "c4":
     str1 = @"[\u4e00-\u9fa5]+$";
     break;

     case "c5":
     str1 = @"^[\u4e00-\u9fa5]+$";
     break;
     }
     
     //正则表达式用法参考：  https://www.runoob.com/csharp/csharp-regular-expressions.html
     
     MatchCollection matches = Regex.Matches(txt, str1);
     List<string> stringList = new List<string>();
     
     foreach (Match match in matches)
     {
         stringList.Add(match.Value);
     }

     a = stringList;
    }
}
# ---------- end 正则表达式 ----------
panel_18 = Panel(正则表达式)

# ----
# C#  获得正切边缘
brep_3 = Brep(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)
获得正切边缘 = 获得正切边缘(Brep1=brep_3)  # -> smooth, notsmooth; inputs Brep1: Brep
# ---------- 获得正切边缘: C# ----------
// Grasshopper Script Instance
using System;
using System.Collections;
using System.Collections.Generic;
using System.Drawing;

using Rhino;
using Rhino.Geometry;

using Grasshopper;
using Grasshopper.Kernel;
using Grasshopper.Kernel.Data;
using Grasshopper.Kernel.Types;

public class Script_Instance : GH_ScriptInstance
{
  /* 
    Members:
      RhinoDoc RhinoDocument
      GH_Document GrasshopperDocument
      IGH_Component Component
      int Iteration

    Methods (Virtual & overridable):
      Print(string text)
      Print(string format, params object[] args)
      Reflect(object obj)
      Reflect(object obj, string method_name)
  */
  
  private void RunScript(Brep Brep1, ref object smooth, ref object notsmooth)
  {
  List<Curve> curve1 = new List<Curve>();
  List<Curve> curve2 = new List<Curve>();

   foreach (BrepEdge bc1 in Brep1.Edges)
   {
    if (bc1.IsSmoothManifoldEdge())
    {
     curve1.Add(bc1.DuplicateCurve());
    } 
     else 
    {
     curve2.Add(bc1.DuplicateCurve());
    }
   }
    smooth = curve1;
    notsmooth = curve2;
  }
}
# ---------- end 获得正切边缘 ----------
curve_2 = Curve(获得正切边缘.notsmooth)
curve_3 = Curve(获得正切边缘.smooth)

# ----
# C#  删除占位电池
button_2 = Button()
c_script_3 = CSharpScript(delete=button_2)  # inputs delete: Boolean
# ---------- c_script_3: C# ----------
// Grasshopper Script Instance
#region Usings
using System;
using System.Linq;
using System.Collections;
using System.Collections.Generic;
using System.Drawing;

using Rhino;
using Rhino.Geometry;

using Grasshopper;
using Grasshopper.Kernel;
using Grasshopper.Kernel.Data;
using Grasshopper.Kernel.Types;
#endregion

public class Script_Instance : GH_ScriptInstance
{
    private void RunScript(bool delete)
    {
       if(delete)
       {
         var doc = this.Component.OnPingDocument();
        
         if(doc == null)
         {
             return;
         }

         var objs = doc.Objects;
         var deleteComs = objs.Where(o => o.GetType().ToString() == "Grasshopper.Kernel.Components.GH_PlaceholderComponent").ToList();
       
         if(deleteComs == null || deleteComs.Count == 0)
         {
             return;
         }
         doc.ScheduleSolution(20, (d) => doc.RemoveObjects(deleteComs, false));
       }
    }
}
# ---------- end c_script_3 ----------

# ----
# python  删除占位电池
button_3 = Button()
python_3_script = Python3Script(delete=button_3)  # inputs delete: Boolean
# ---------- python_3_script: Python ----------
if(delete):
    doc = ghenv.Component.OnPingDocument()
    if(doc != None):
        objs = doc.Objects
        deleteComs = [obj for obj in objs if(str(type(obj))== "<type 'GH_PlaceholderComponent'>")]
        if(deleteComs!=None):
            func = lambda d:doc.RemoveObjects(deleteComs, False)
            doc.ScheduleSolution(20, func )
# ---------- end python_3_script ----------

# ----
# C#  挤出(extrude)mesh
number_slider_9 = Slider(71, range=0..100)
unit_z = UnitZ(Factor=1)
mesh = Mesh(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)
extrudemesh = Extrudemesh(mesh=mesh, direction=unit_z, distance=number_slider_9, solidify=Toggle(True))  # -> out, a; inputs mesh: Mesh, direction: Vector3d, distance: Double, solidify: Boolean
# ---------- extrudemesh: C# ----------
// Grasshopper Script Instance
#region Usings
using System;
using System.Linq;
using System.Collections;
using System.Collections.Generic;
using System.Drawing;

using Rhino;
using Rhino.Geometry;

using Grasshopper;
using Grasshopper.Kernel;
using Grasshopper.Kernel.Data;
using Grasshopper.Kernel.Types;
#endregion

public class Script_Instance : GH_ScriptInstance
{
    #region Notes
    /* 
      Members:
        RhinoDoc RhinoDocument
        GH_Document GrasshopperDocument
        IGH_Component Component
        int Iteration

      Methods (Virtual & overridable):
        Print(string text)
        Print(string format, params object[] args)
        Reflect(object obj)
        Reflect(object obj, string method_name)
    */
    #endregion

    private void RunScript(
	Mesh mesh,
	Vector3d direction,
	double distance,
	bool solidify,
	ref object a)
    {
	 mesh = mesh.Offset(distance, solidify, direction);
    
     a = mesh;
    }
}
# ---------- end extrudemesh ----------
mesh_2 = Mesh(extrudemesh.a)

# ----
# 生成不重复整数随机数
number_slider_10 = Slider(1, range=0..10)
生成不重复整数随机数 = Script(num=Slider(6, range=0..10), seed=Slider(6, range=0..10), min=number_slider_10, max=Slider(10, range=0..10))  # -> out, a; inputs num: Int32, seed: Int32, min: Int32, max: Int32
# ---------- 生成不重复整数随机数: C# ----------
// Grasshopper Script Instance
#region Usings
using System;
using System.Linq;
using System.Collections;
using System.Collections.Generic;
using System.Drawing;

using Rhino;
using Rhino.Geometry;

using Grasshopper;
using Grasshopper.Kernel;
using Grasshopper.Kernel.Data;
using Grasshopper.Kernel.Types;
#endregion

public class Script_Instance : GH_ScriptInstance
{
    #region Notes
    /* 
      Members:
        RhinoDoc RhinoDocument
        GH_Document GrasshopperDocument
        IGH_Component Component
        int Iteration

      Methods (Virtual & overridable):
        Print(string text)
        Print(string format, params object[] args)
        Reflect(object obj)
        Reflect(object obj, string method_name)
    */
    #endregion

    private void RunScript(int num, int seed, int min, int max, ref object a)
    {
       var randomints = new List<int>();
       Random random1 = new Random(seed);
       string wrongtext = new string ("num has to be larger than range");

       if(num >= max - min + 1)
       {
         a = wrongtext;
         return;
       }
        
       while(randomints.Count < num)
       {
         int tempint = random1.Next(min,max);
         if(!randomints.Contains(tempint))
            {
             randomints.Add(tempint);
            }

         a = randomints;
       }      

    }
}
# ---------- end 生成不重复整数随机数 ----------
panel_19 = Panel(生成不重复整数随机数.a)

# ----
# C# 批量导出已命名快照
panel_20 = Panel("C:\Users\Administrator\Desktop")
filetype = ValueList({"Png": .png, "Jpg": .jpg}, selected="Png")
批量导出已命名快照 = Script(getnames=Toggle(True), getsnapshots=Button(), filepath=panel_20, filetype=filetype)  # inputs getnames: Boolean, getsnapshots: Boolean, filepath: String, filetype: String
# ---------- 批量导出已命名快照: C# ----------
// Grasshopper Script Instance
#region Usings
using System;
using System.Linq;
using System.Collections;
using System.Collections.Generic;
using System.Drawing;

using Rhino;
using Rhino.Geometry;

using Grasshopper;
using Grasshopper.Kernel;
using Grasshopper.Kernel.Data;
using Grasshopper.Kernel.Types;
#endregion

public class Script_Instance : GH_ScriptInstance
{
    private void RunScript(
	bool getnames,
	bool getsnapshots,
	string filepath,
	string filetype)
    {
     string[] snapshotsnames_collection = null;
     string snapshots_filename = "";
     
     if(getnames)
     {
         RhinoDoc activeDoc = RhinoDoc.ActiveDoc;
         var snapshots_table = activeDoc.Snapshots;
         string[] snapshots_table_names = snapshots_table.Names;
         snapshotsnames_collection = snapshots_table_names;
     }

     if(getsnapshots)
     {
         foreach(string snapsshot_name in snapshotsnames_collection)
         { 
             snapshots_filename = filepath + "\\" + snapsshot_name + filetype;
             Rhino.RhinoApp.RunScript(String.Format("-Snapshots {0} {1} enterend", "R",snapsshot_name), true);
             Rhino.RhinoApp.RunScript(String.Format("-ViewCaptureToFile {0}", snapshots_filename), true);
         }
     }
    }
}
# ---------- end 批量导出已命名快照 ----------

# ----
# C# 批量导出已命名视图
panel_21 = Panel("C:\Users\Administrator\Desktop")
filetype_2 = ValueList({"Png": .png, "Jpg": .jpg}, selected="Png")
批量导出已命名视图 = Script(getnames=Toggle(True), getviews=Button(), filepath=panel_21, filetype=filetype_2)  # inputs getnames: Boolean, getviews: Boolean, filepath: String, filetype: String
# ---------- 批量导出已命名视图: C# ----------
// Grasshopper Script Instance
#region Usings
using System;
using System.Linq;
using System.Collections;
using System.Collections.Generic;
using System.Drawing;

using Rhino;
using Rhino.Geometry;

using Grasshopper;
using Grasshopper.Kernel;
using Grasshopper.Kernel.Data;
using Grasshopper.Kernel.Types;
#endregion

public class Script_Instance : GH_ScriptInstance
{
    private void RunScript(
	bool getnames,
	bool getviews,
	string filepath,
	string filetype)
    {
     List<String> namedview_list = new List<String>();
     
     if(getnames)
     {
         RhinoDoc activeDoc = RhinoDoc.ActiveDoc;
         var viewTableList = activeDoc.NamedViews;
         
         for(int i = 0;i < viewTableList.Count;i++)
         {
         namedview_list.Add(viewTableList[i].Name);
         }
     }

     if(getviews)
     {
         foreach(string viewname in namedview_list)
         { 
             string view_filename = filepath + "\\" + viewname + filetype;
             Rhino.RhinoApp.RunScript(String.Format("-NamedView {0} enterend",viewname), true);
             Rhino.RhinoApp.RunScript(String.Format("-ViewCaptureToFile {0}", view_filename), true);
         }
     }
    }
}
# ---------- end 批量导出已命名视图 ----------

# ----
# C#   合并共面brep/surface
brep_4 = Brep([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])
script_3 = Script(breps=brep_4)  # -> merge_breps; inputs breps: Brep
# ---------- script_3: C# ----------
// Grasshopper Script Instance
#region Usings
using System;
using System.Linq;
using System.Collections;
using System.Collections.Generic;
using System.Drawing;

using Rhino;
using Rhino.Geometry;

using Grasshopper;
using Grasshopper.Kernel;
using Grasshopper.Kernel.Data;
using Grasshopper.Kernel.Types;
#endregion

public class Script_Instance : GH_ScriptInstance
{
    private void RunScript(Brep breps, ref object merge_breps)
    {
     double t1 = this.RhinoDocument.ModelAbsoluteTolerance;
     double t2 = this.RhinoDocument.ModelAngleToleranceDegrees;
     double t3 = this.RhinoDocument.ModelAngleToleranceRadians;
     breps.MergeCoplanarFaces(t1,t2);
     merge_breps = breps;
    }
}
# ---------- end script_3 ----------
brep_5 = Brep(script_3)

# ----
# C#  mesh在指定角度炸开
number_slider_11 = Slider(5.072, range=0..360)
mesh_3 = Mesh(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)
explode_mesh_at_angle = ExplodeMeshAtAngle(m=mesh_3, d=number_slider_11, b=Toggle(True))  # -> out, graft(a); inputs m: Mesh, d: Double, b: Boolean
# ---------- explode_mesh_at_angle: C# ----------
// Grasshopper Script Instance
#region Usings
using System;
using System.Linq;
using System.Collections;
using System.Collections.Generic;
using System.Drawing;

using Rhino;
using Rhino.Geometry;

using Grasshopper;
using Grasshopper.Kernel;
using Grasshopper.Kernel.Data;
using Grasshopper.Kernel.Types;
#endregion

public class Script_Instance : GH_ScriptInstance
{
    private void RunScript(Mesh m, double d, bool b, ref object a)
    {
     double v = RhinoMath.ToRadians(d);
     m.Unweld(v,b);
     Mesh[] e = m.ExplodeAtUnweldedEdges(); 
     a = e;
    }
}
# ---------- end explode_mesh_at_angle ----------
explode_tree = ExplodeTree(Data=explode_mesh_at_angle.a)  # -> Branch0, Branch1, Branch2, Branch3, Branch4, Branch5
mesh_4 = Mesh(explode_tree.Branch1)
mesh_5 = Mesh(explode_tree.Branch2)
mesh_6 = Mesh(explode_tree.Branch3)
mesh_7 = Mesh(explode_tree.Branch0)
mesh_8 = Mesh(explode_tree.Branch5)
mesh_9 = Mesh(explode_tree.Branch4)

# ----
# C# mesh颜色变成图片材质
texture_file = Panel("C:\Users\Administrator\Desktop\1234.png")
mesh_10 = Mesh(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)
mesh颜色变成图片材质 = CSharpScript(mesh=mesh_10, file_address=texture_file, transform=Button())  # -> new_mesh; inputs mesh: Mesh, file_address: String, transform: Boolean
# ---------- mesh颜色变成图片材质: C# ----------
#region Usings
using System;
using System.Linq;
using System.Collections;
using System.Collections.Generic;
using System.Drawing;

using Rhino;
using Rhino.Geometry;

using Grasshopper;
using Grasshopper.Kernel;
using Grasshopper.Kernel.Data;
using Grasshopper.Kernel.Types;
#endregion

public class Script_Instance : GH_ScriptInstance
{
    private void RunScript(
	Mesh mesh,
	string file_address,
	bool transform,
	ref object new_mesh)
    {
     mesh.Unweld(0, false);
     mesh.TextureCoordinates.Clear();

     for(int i = 0;i < mesh.Vertices.Count;i++)
     {
     mesh.TextureCoordinates.Add(0, 0);
     }
      
     int size = (int) Math.Ceiling(Math.Sqrt(mesh.Faces.Count));
     double fSize = (double) size * 2;

     Bitmap bitmap = new Bitmap(size * 2, size * 2);

     for(int i = 0;i < mesh.Faces.Count;i++)
     {
     MeshFace face = mesh.Faces[i];
     int x = (i % size) * 2;
     int y = (i / size) * 2;
     double fx = (double) x;
     double fy = (double) y;

     mesh.TextureCoordinates[face.A] = new Point2f((fx + 0.5) / fSize, (fy + 0.5) / fSize);
     mesh.TextureCoordinates[face.B] = new Point2f((fx + 1.5) / fSize, (fy + 0.5) / fSize);
     mesh.TextureCoordinates[face.C] = new Point2f((fx + 1.5) / fSize, (fy + 1.5) / fSize);
     mesh.TextureCoordinates[face.D] = new Point2f((fx + 0.5) / fSize, (fy + 1.5) / fSize);

     Color colorA = mesh.VertexColors[face.A];
     colorA = Color.FromArgb(255, colorA.R, colorA.G, colorA.B);
     Color colorB = mesh.VertexColors[face.B];
     colorB = Color.FromArgb(255, colorB.R, colorB.G, colorB.B);
     Color colorC = mesh.VertexColors[face.C];
     colorC = Color.FromArgb(255, colorC.R, colorC.G, colorC.B);
     Color colorD = mesh.VertexColors[face.D];
     colorD = Color.FromArgb(255, colorD.R, colorD.G, colorD.B);

     y = size * 2 - 2 - y;
     bitmap.SetPixel(x + 0, y + 1, colorA);
     bitmap.SetPixel(x + 1, y + 1, colorB);
     bitmap.SetPixel(x + 1, y + 0, colorC);
     bitmap.SetPixel(x + 0, y + 0, colorD);
     }

     if(transform)
     {
     bitmap.Save(file_address, System.Drawing.Imaging.ImageFormat.Png);
     }
     new_mesh = mesh;
    }
}
# ---------- end mesh颜色变成图片材质 ----------
mesh_11 = Mesh(mesh颜色变成图片材质)

# ----
# C#  在UnweldedEdges炸开mesh
mesh_12 = Mesh(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)
explode_mesh_at_unweldededges = ExplodeMeshAtUnweldedEdges(x=flatten(mesh_12))  # -> out, simplify(graft(a)); inputs x: Mesh
# ---------- explode_mesh_at_unweldededges: C# ----------
#region Usings
using System;
using System.Linq;
using System.Collections;
using System.Collections.Generic;
using System.Drawing;

using Rhino;
using Rhino.Geometry;

using Grasshopper;
using Grasshopper.Kernel;
using Grasshopper.Kernel.Data;
using Grasshopper.Kernel.Types;
#endregion

public class Script_Instance : GH_ScriptInstance
{

    private void RunScript(Mesh x, ref object a)
    {
    Mesh[] e = x.ExplodeAtUnweldedEdges();    
    a = e;
    }
}
# ---------- end explode_mesh_at_unweldededges ----------
explode_tree_2 = ExplodeTree(Data=explode_mesh_at_unweldededges.a)  # -> Branch0, Branch1, Branch2, Branch3, Branch4, Branch5
mesh_13 = Mesh(explode_tree_2.Branch4)
mesh_14 = Mesh(explode_tree_2.Branch3)
mesh_15 = Mesh(explode_tree_2.Branch0)
mesh_16 = Mesh(explode_tree_2.Branch1)
mesh_17 = Mesh(explode_tree_2.Branch2)
mesh_18 = Mesh(explode_tree_2.Branch5)

# ----
# C#   自定义相机位置并获取meshoutline
number_slider_12 = Slider(45, range=0..100)
point = Point(Point(606.1170126, -31.20118311, 517.9802653))
point_2 = Point(Point(124.8368606, -31.20118311, 120.3126893))
mesh_19 = Mesh(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)
set_camera_get_meshoutline = Set_cameraGet_meshoutline(
    camera_location=point,
    camera_direction=point_2,
    camera_lens=number_slider_12,
    degree=Slider(346, range=0..1000),
    mesh=mesh_19,
    is_on=Toggle(False))  # -> points, meshoutlines; inputs camera_location: Point3d, camera_direction: Point3d, camera_lens: Double, degree: Double, mesh: Mesh, is_on: Boolean
# ---------- set_camera_get_meshoutline: C# ----------
// Grasshopper Script Instance
#region Usings
using System;
using System.IO;
using System.Linq;
using System.Data;
using System.Drawing;
using System.Reflection;
using System.Windows.Forms;
using System.Xml;
using System.Xml.Linq;
using System.Runtime.InteropServices;

using Rhino;
using Rhino.Geometry;
using Rhino.DocObjects;
using Rhino.Collections;

using Grasshopper;
using Grasshopper.Kernel;
using Grasshopper.Kernel.Data;
using Grasshopper.Kernel.Types;

#endregion

public class Script_Instance : GH_ScriptInstance
{
    private void RunScript(
	Point3d camera_location,
	Point3d camera_direction,
	double camera_lens,
	double degree,
	Mesh mesh,
	bool is_on,
	ref object points,
	ref object meshoutlines)
    {
         if(is_on)
         {
             Rhino.Display.RhinoViewport view = RhinoDocument.Views.ActiveView.ActiveViewport;
             view.SetCameraLocation(camera_location, false);
             Vector3d vec_of_view = camera_direction - camera_location;
             view.SetCameraDirection(vec_of_view, false);
             view.Camera35mmLensLength = camera_lens;
             Vector3d cz = view.CameraZ;
             double x = degree / 180 * Math.PI;
             cz.Rotate(degree / x, view.CameraY);
             view.Rotate(x, view.CameraZ, view.CameraLocation);
             points = view.GetNearRect();
             meshoutlines = mesh.GetOutlines(view);
             




            


         }
    }
}
# ---------- end set_camera_get_meshoutline ----------
point_3 = Point(set_camera_get_meshoutline.points)
curve_4 = Curve(set_camera_get_meshoutline.meshoutlines)
