# Grasshopper definition 20250124_按规范与已有道路线生成车道(过程中)_1.gh (Grasshopper 1.0.8)
# plug-ins: RhinoCodePluginGH

直行标识 = Curve(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)
discontinuity = Discontinuity(Curve=直行标识, Level=1)  # -> Points, Parameters
curve = Curve(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)
curve_2 = Curve(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)
cluster = Cluster(relay_2=curve, relay=Slider(47, range=12..60))  # -> i, curve, loft_2
cluster_2 = Cluster(relay_2=curve_2, relay=Slider(46, range=12..60))  # -> i, curve, loft_2
panel = Panel(discontinuity.Points)
greenseparation = ValueList({"Both", "Middle", "Side", "None"}, selected="Both")
zebracrossing = ValueList({"Both", "Start", "End", "None"}, selected="Both")
waitingarea = ValueList({"Both", "Start", "End", "None"}, selected="Both")
bikeway = ValueList({"Both", "Right", "Left", "None"}, selected="Both")
oneway = BooleanToggle(False)
roadsurface = Geometry(cluster_2.loft_2)
curve1 = Curve(cluster_2.i)
curve2 = Curve(cluster_2.curve)
panel_2 = Panel("""1.class内不要有method
2.一层method决定生成策略
3.一层method生成平面线
4.一层method投影并生成mesh""")
c_script = CSharpScript(
    Curve1=curve1,
    Curve2=curve2,
    RoadSurface=roadsurface,
    Oneway=oneway,
    WaitingArea=waitingarea,
    ZebraCrossing=zebracrossing,
    GreenSeparation=greenseparation,
    BikeWay=bikeway)  # -> WhiteLine, YellowLine, GreenLand, Parterre, a; inputs Curve1: Curve, Curve2: Curve, RoadSurface: Brep, Oneway: Boolean, WaitingArea: String, ZebraCrossing: String, GreenSeparation: String, BikeWay: String
# ---------- c_script: C# ----------
// Grasshopper Script Instance
#region Usings
using System;
using System.Linq;
using System.Collections;
using System.Collections.Generic;
using System.Drawing;

using Rhino;
using Rhino.Geometry;

using Grasshopper;
using Grasshopper.Kernel;
using Grasshopper.Kernel.Data;
using Grasshopper.Kernel.Types;
#endregion

public class Script_Instance : GH_ScriptInstance
{
    private void RunScript(
	Curve Curve1,
	Curve Curve2,
	Brep RoadSurface,
	bool Oneway,
	string WaitingArea,
	string ZebraCrossing,
	string GreenSeparation,
	string BikeWay,
	ref object WhiteLine,
	ref object YellowLine,
	ref object GreenLand,
	ref object Parterre,
	ref object a){
        Mesh[] Road_Mesh_Array = Rhino.Geometry.Mesh.CreateFromBrep(RoadSurface,Rhino.Geometry.MeshingParameters.QualityRenderMesh);//生成道路面mesh
        //double t_absolute = this.RhinoDocument.ModelAbsoluteTolerance;
        //double t_angle_degrees = this.RhinoDocument.ModelAngleToleranceDegrees;
        //double t_angle_radians = this.RhinoDocument.ModelAngleToleranceRadians;
        
        Curve curve1_plan = Rhino.Geometry.Curve.ProjectToPlane(Curve1, Plane.WorldXY);//Curve1的平面线
        Curve curve2_plan = Rhino.Geometry.Curve.ProjectToPlane(Curve2, Plane.WorldXY);//Curve2的平面线
        //市政道路最大坡度8%，cos值极小。故默认道路曲面与其平面投影上的形状变化忽略不计

        double start_to_start = curve1_plan.PointAtStart.DistanceTo(curve2_plan.PointAtStart);
        double start_to_end = curve1_plan.PointAtStart.DistanceTo(curve2_plan.PointAtEnd);
        if(start_to_start > start_to_end){//判断Curve1和Curve2的方向是否相同，不相同则反转curve2
            curve2_plan.Reverse();
        }

        Point3d cpoint_curve1 = new Point3d();
        Point3d cpoint_curve2 = new Point3d();
        Curve1.ClosestPoints(Curve2, out cpoint_curve1, out cpoint_curve2);
        double road_wide = cpoint_curve1.DistanceTo(cpoint_curve2);//道路在空间上的宽度double

        RoadIdentification RI_test1 = new RoadIdentification(Plane.WorldXY,"111");
        Mesh RI_mesh_test = RI_test1.CRI(Road_Mesh_Array,this.RhinoDocument);
        a = RI_mesh_test;
    }

    public class TrafficLine{//定义CLASS :交通标识线;  包含属性：中线Curve MiddleCurve & 标线类型string LineType; 待写方法一个
        
        public Curve MiddleCurve {get; set;}
        public string LineType {get; set;}

        public TrafficLine(Curve curve, string type){
            MiddleCurve = curve;
            LineType = type;
        }

        //public void GeneratingLine (){}   待生成的方法：直接生成标线的mesh（调用？）
    }

    public class GreenSeparation{//定义CLASS :绿化分隔;  包含属性：中线Curve MiddleCurve & 绿化宽度double GreenWide; 待写方法一个
        
        public Curve MiddleCurve {get; set;}
        public double GreenWide {get; set;}

        public GreenSeparation(Curve curve, double wide){
            MiddleCurve = curve;
            GreenWide = wide;
        }

        //public void GeneratingGreenSeparation (){}   待生成的方法：直接生成绿化的mesh（调用？）
    }

    public class RoadIdentification{//定义CLASS :路面标识;  包含属性：平面IdentificationPlan & 标识类型string IdentificationType;
        
        public Plane IdentificationPlan {get; set;}
        public string IdentificationType {get; set;}

        public RoadIdentification(Plane plane, string type){
            IdentificationPlan = plane;
            IdentificationType = type;
        }

        public Mesh CRI(Mesh[] mesh_array, RhinoDoc document){
            Mesh mesh_road = Creating_RI_ZhiXing(IdentificationPlan, mesh_array, document);
            return mesh_road;
        }
    }

    public static Mesh Creating_RI_ZhiXing(Plane plane1, Mesh[] mesh_array, RhinoDoc document){// 生成直行标识的方法
        List<Point3d> points = new List<Point3d>();
        points.Add(new Point3d(0,3,0));
        points.Add(new Point3d(0.45,0.6,0));
        points.Add(new Point3d(0.15,0.6,0));
        points.Add(new Point3d(0.15,-3,0));
        points.Add(new Point3d(-0.15,-3,0));
        points.Add(new Point3d(-0.15,0.6,0));
        points.Add(new Point3d(-0.45,0.6,0));
        points.Add(new Point3d(0,3,0));
        PolylineCurve polylinecurve_plan1 = new PolylineCurve(points);
        Curve curve_plan1 = polylinecurve_plan1.ToNurbsCurve();
        curve_plan1.Transform(Rhino.Geometry.Transform.PlaneToPlane(Plane.WorldXY, plane1));

        Curve[] curve_project_array = Rhino.Geometry.Curve.ProjectToMesh(curve_plan1, mesh_array, Vector3d.ZAxis, document.ModelAbsoluteTolerance);
        Curve[] curve_array_tmp = Rhino.Geometry.Curve.JoinCurves(curve_project_array);

        Mesh mesh_RI = new Mesh();
        for(int i = 0; i < curve_array_tmp.Length; i++){
            Polyline polyline_tmp = new Polyline();
            curve_array_tmp[i].TryGetPolyline(out polyline_tmp);
            //也可以用curve.GrevillePoints()这个方法获得控制点再生成polyline

            if(polyline_tmp != null){
                Mesh mesh_tep = Rhino.Geometry.Mesh.CreatePatch(polyline_tmp, document.ModelAngleToleranceRadians, null, null, null, null, true, 0);
                mesh_RI.Append(mesh_tep);
            }
        }

        return mesh_RI;
    }
}
# ---------- end c_script ----------
whiteline = Mesh(c_script.WhiteLine)
curve_3 = Curve(c_script.a)
mesh = Mesh(c_script.YellowLine)
mesh_2 = Mesh(c_script.Parterre)
mesh_3 = Mesh(c_script.a)
mesh_4 = Mesh(c_script.GreenLand)
curve_4 = Curve(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)
cluster_3 = Cluster(relay_2=curve_4, relay=Slider(46, range=12..60))  # -> i, curve, loft_2
greenseparation_2 = ValueList({"Both", "Middle", "Side", "None"}, selected="Both")
zebracrossing_2 = ValueList({"Both", "Start", "End", "None"}, selected="Both")
waitingarea_2 = ValueList({"Both", "Start", "End", "None"}, selected="Both")
bikeway_2 = ValueList({"Both", "Right", "Left", "None"}, selected="Both")
oneway_2 = BooleanToggle(False)
roadsurface_2 = Geometry(cluster_3.loft_2)
curve1_2 = Curve(cluster_3.i)
curve2_2 = Curve(cluster_3.curve)
c_script_2 = CSharpScript(
    Curve1=curve1_2,
    Curve2=curve2_2,
    RoadSurface=roadsurface_2,
    Oneway=oneway_2,
    WaitingArea=waitingarea_2,
    ZebraCrossing=zebracrossing_2,
    GreenSeparation=greenseparation_2,
    BikeWay=bikeway_2)  # -> WhiteLine, YellowLine, GreenLand, Parterre, a; inputs Curve1: Curve, Curve2: Curve, RoadSurface: Brep, Oneway: Boolean, WaitingArea: String, ZebraCrossing: String, GreenSeparation: String, BikeWay: String; same code as c_script
whiteline_2 = Mesh(c_script_2.WhiteLine)
curve_5 = Curve(c_script_2.a)
mesh_5 = Mesh(c_script_2.YellowLine)
mesh_6 = Mesh(c_script_2.Parterre)
mesh_7 = Mesh(c_script_2.a)
mesh_8 = Mesh(c_script_2.GreenLand)

# ==== cluster Cluster
relay = ClusterInput()
relay_2 = ClusterInput()
xy_plane = XYPlane(Origin=Point(0, 0, 0))
offset_curve_loose = OffsetCurveLoose(Curve=relay_2, Distance=relay, Plane=xy_plane)
merge = Merge(Data1=relay_2, Data2=offset_curve_loose)  # -> flatten(Result)
loft = Loft(Curves=merge, Options={Adjust=False, Closed=False, LoftEnds=0, LoftSimp=0, LoftType=0, Rebuild=10, Refit=0.01})
i = ClusterOutput(relay_2)
curve = ClusterOutput(offset_curve_loose)
loft_2 = ClusterOutput(loft)
